# Grasshopper definition SimpleLinkExample.gh (Grasshopper 1.0.7)
# plug-ins: Human

topo = Panel("""2,0
1,0
3,0""")
points = Panel("""2.50,  0.0, 0.0
0.0, 1.80, 0.0
0.0,  0.0, 0.0
0.0, 3.00, 0""")
pt = Point(points)
topo_2 = Data(topo)
force = Slider(15, range=0..25)
inputwriter = GhPythonScript(nodes=pt, topo=topo_2, force=force)  # -> out, ansysFileStrings; inputs nodes: list, topo: list
# ---------- inputwriter: Python ----------
"""This component takes various inputs and cobbles them together into a string that is a 
usable Ansys input. 

This python component is intended to be modified by the users to suit their own simulation
needs. For this reason, there's a reasonable expection of understanding of Python
and Ansys from the end user. Hopefully this component can be expanded on in the future
and provide simpler methods for the user...

Right now a lot of the simulation parameters are hard coded in this file. However, this
is a very practical way of putting together the Ansys input file. I recomend using
the Ansys Mechanical with the GUI interface to setup your simulation. Then you can 
look at the commands that were used in the log. You can use that log file as a basis 
for your integration with your Grasshopper definition.

    Inputs:
        nodes: list of points that will be used to describe the 
        
        topo: provde the pair of points to be used as the lines that form each element here
        format is list item number, list item number or 0,1 to connect point 0 to 1.
        
        force: right now force is hard codded to be a force applied on one of the nodes is y direction.
        

    Outputs:
        
        ansysFileStrings: this is the output in the form of the raw text for an Ansys input
"""
        
__author__ = "Louis Leblanc"
__version__ = "2018.11.05"

#use 'text' as a running variable to hold our whole file
#start by adding the Ansys header
text='''
/FILNAM,truss
/title, Simple Truss
/prep7

'''

#print nodes. These denote the ends of the elements
for point in range(len(nodes)):
    #note we're starting with node 1 rather than node 0 as we had it in GH
    text = text + ("n, "+ str(point+1)+ ", " +  nodes[point] +"\n")

#add functionalities here later on but we're defining the properties of the elements
text = text + '''
et, 1, link180             ! Element type; no.1 is link180
sectype, 1, link           ! Type of cross section is link 
secdata, 697e-6            ! Cross sectional area = 0.5 sq in
mp, ex, 1, 200e3           !  material property #1; Young's modulus: 200 GPa
mp, prxy, 1, 0.3           ! & poisson's ratio for material no.1

'''

#print elements
for currentLine in range(len(topo)):
    #seperate the two values we've given into a Python list
    elem = topo[currentLine].split(",")
    #make the strings into ints and add 1 to them as the points in Ansys
    #start at 1 and not 0 like we had in GH
    elem= [int(i)+1 for i in elem]
    #join the two numbers back into a str
    elem = ",".join([str(x) for x in elem])
    #finally make the line of text
    text = text + ("en, "+ str(currentLine+1)+ ", " + elem   +"\n")

#print boundary conditions - again this is hard coded for now
#using a similar strategy as was used for writing the elements
#and nodes, these could be linked to 
text = text+ '''
d, 3, ux, 0.             ! Displacement at node 3 in x-dir is zero
d, 3, uy, 0.             ! Displacement at node 3 in y-dir is zero
d, 2, ux, 0.
d, 2, uy, 0.
d, 4, ux, 0.
d, 4, uy, 0.

'''

#print force value
text = text + ("f, 1, fy, " + str(force))

#print command to run the simulation and include all the post processing code
text = text + '''
finish
/solu                    ! Select static load solution
antype, static
solve
finish
save
/post1                   ! Use 'ssum' to compute sums interactively
!alls
'''

#we now print the post processing which will give us the nodal displacement
#you could modify this part to include other data you may want
#horay for Fortran, not.
text = text + '''
!make a CSV for nodal data
*CFOPEN,nodeOutput,txt

*GET,num_nodes_,NODE,0,COUNT !Get the number of nodes
*GET,node_,NODE,0,NUM,MIN !Get label of the first node

*DO,i,1,num_nodes_,1
  ! Define some parameters - we're getting the displacement
  *GET,nx_,NODE,node_,U,X
  *GET,ny_,NODE,node_,U,Y
  *GET,nz_,NODE,node_,U,Z
  !NSOL can be used for other values
  
  ! Write line
  *VWRITE,nx_,ny_,nz_
  (E10.3,',',E10.3,',',E10.3)
  
  ! select the next node
  *GET,node_,NODE,node_,NXTH
  
*ENDDO
*CFCLOSE
'''

#We now print the command to get the results for the elements. More
#queries could be done at this point. I'm also including a portion that's
#commented out to get a PRESOL - this could be useful for debuging as it
#gives a lot more context than ESOL which is element by element.
#

text = text+ '''

!Create an ETABLE with the axial stress
ETABLE,myTable,LS, 1

!Uncomment this to print out the etable
!/output,etablePrint,out
!PRETAB,myTable
!/out

!PRINTS THE STRESS VALUES LINE BY LINE TO A FILE
*CFOPEN,elemOutput,txt
*GET,num_elems_,ELEM,0,COUNT !Get the number of elems
*GET,elem_,ELEM,0,NUM,MIN !Get label of the first elems

*DO,i,1,num_elems_,1
  ! Define some parameters
  *GET,seqv,ETAB,1,ELEM,elem_

  ! Write line
  *VWRITE,seqv
  (E10.3)
  
  ! select the next elem
  *GET,elem_,ELEM,elem_,NXTH

*ENDDO
*CFCLOSE

!Uncomment this to get the regular print by elements
!/output,print_output,txt     ! redirect output to a file called "print_output.txt"
!PRESOL,S, PRNT
'''

ansysFileStrings= text
# ---------- end inputwriter ----------
panel = Panel("C:\Program Files\ANSYS Inc\ANSYS Student\v191\ansys\bin\winx64\ANSYS191")
ansys_file_preview = Panel(inputwriter.ansysFileStrings)
execute = GhPythonScript(installLocation=panel, workFolder="C:/Users/louis", ansysFileStrings=inputwriter.ansysFileStrings, run=Button())  # -> nodeFile, elemFile
# ---------- execute: Python ----------
"""This component takes an Ansys file input as a strign, bottles it up
and starts Ansys to run the simulation

    Inputs:
        installLocation: provide your installation location for Ansys
        likely to look like: C:\Program Files\ANSYS Inc\ANSYS Student\v191\ansys\bin\winx64\ANSYS191
        In your file explorer, that file will actually have the extension .exe but don't include it.
        
        
        workFolder: provide a disk location where you want to start the program from. All files will 
        be written to this folder
        
        ansysFileStrings: provide your full Ansys input as a multiline string that's in a single
        Grasshopper item
        
        run: boolean toggle to start the simulation
        
    Outputs:
        These are files we're creating in our Ansys input file. Keep in mind 
        you could easily add your own files here. Just add them to the
        writeBatchFile function.
        
        nodeFile: Folder location for the nodal solutions
        nodeFile: Folder location for the elemental solutions
        
"""
        
__author__ = "Louis Leblanc"
__version__ = "2018.11.05"
        
import os
        
###Function Definitions

#Write out the Ansys input file we've wrote out in the previous Python component
def writeInputFile(folderLocation, ansysInputFile):
    f = open( (workFolder+'\ghAnsysInput.txt'),'w') #make a string from the work folder + the name we give to the input file
    f.write(ansysInputFile) #write the data into the file
    f.close()

#Define a batch file that we'll call later on. You could even call other programs to run this way
def writeBatchFile(folderLocation):
    f = open( (workFolder+r'\ghAnsys.bat'),'w') #name of batch file we'll use
    batchString = "cd " + folderLocation + "\n" #change working folder of command line
    batchString = batchString + r'"'  +installLocation + r'" -b ' #make sure this matches the location on your computer with an exe file
    batchString = batchString + r'-i "' + folderLocation + r'\ghAnsysInput.txt"'
    batchString = batchString + r' -o "' + folderLocation + r'\ghAnsysOutput.txt"' #this is the Ansys general stats and info file 
    f.write(batchString)
    f.close()


###Execution Code

#provide the location of the solution data files to be used later in GH file
nodeFile = workFolder + r'/nodeOutput.txt'
elemFile = workFolder + r'/elemOutput.txt'

#use a simple switch to write the files and start the analysis if run is true
#you may want to look at modifying the condition if you want Ansys to run
#on every GH state change such as when running optimization methods.
if run:
    writeInputFile(workFolder, ansysFileStrings)
    writeBatchFile(workFolder)
    os.system(workFolder+r'\ghAnsys.bat')
# ---------- end execute ----------

# ---- group: Deforme Lines
file = ReadFile(File=execute.nodeFile, PerLineParse=True)
pt_2 = Point(pt)
move = Move(Geometry=pt_2, Motion=file)  # -> Geometry, Transform
deformedpoints = Point(move.Geometry)
linepairindex = GhPythonScript(topo=topo_2)  # -> out, simplify(linePair)
# ---------- linepairindex: Python ----------
linePair = topo.split(",")
# ---------- end linepairindex ----------
item = ListItem(List=linepairindex.linePair, Index=0, Wrap=True)
item_2 = ListItem(List=linepairindex.linePair, Index=1, Wrap=True)
item_3 = ListItem(List=deformedpoints, Index=item_2, Wrap=True)
item_4 = ListItem(List=deformedpoints, Index=item, Wrap=True)
ln = Line(StartPoint=item_4, EndPoint=item_3)
pshift = ShiftPaths(Data=ln, Offset=-1)

# ---- group: Assign Colour Plot
file_2 = ReadFile(File=execute.elemFile, PerLineParse=True)  # -> simplify(flatten(Content))
stress_values = Panel(file_2)
stressvalues = Data(file_2)
sort = SortList(Keys=stressvalues)  # -> Keys, ValuesA
item_5 = ListItem(List=sort.Keys, Index=-1, Wrap=True)
item_6 = ListItem(List=sort.Keys, Index=0, Wrap=True)
gradient = Gradient(
    LowerLimit=item_6,
    UpperLimit=item_5,
    Parameter=stressvalues,
    stops=[0: RGB(255, 0, 0), 0.5: RGB(127, 255, 0), 1: RGB(0, 0, 255)])
material = CreateMaterial(Diffuse=gradient, Specular=gradient, Emission=gradient, Transparency=0, Shine=0)

# ---- group: Display Legend
range = Range(Domain=Domain(0, 1), Steps=100)
item_7 = ListItem(List=range, Index=0, Wrap=True)
panel_2 = Panel("""MAX COMPRESSION
NEUTRAL
MAX TENSION""")
item_8 = ListItem(List=range, Index=-1, Wrap=True)
panel_3 = Panel("""170,15
170,215
170,430""")
gradient_2 = Gradient(
    LowerLimit=item_7,
    UpperLimit=item_8,
    Parameter=range,
    stops=[0: RGB(255, 0, 0), 0.5: RGB(127, 255, 0), 1: RGB(0, 0, 255)])
multiplication = Multiplication(A=range, B=400)
multiplication_2 = Multiplication(A=range, B=0)
pt_3 = ConstructPoint(XCoordinate=50, YCoordinate=expr("X+15", multiplication), ZCoordinate=0)
pt_4 = ConstructPoint(XCoordinate=50, YCoordinate=multiplication_2, ZCoordinate=0)
pttoscreen = RenderPointToScreen(Point=pt_4, Location=pt_3, ScaleFactor=1, Color=gradient_2, Radius=3, Depth=0.95, Fixed=True, m_scWithvp=False)
texttoscreen = RenderTextToScreen(Text=panel_2, Location=panel_3, Size=12, Color=RGB(0, 0, 0), m_scWithvp=False)

# ----
previewlw = CustomPreviewLineweights(Geometry=pshift, Shader=material, Thickness=Slider(5, range=0..10), Absolute=False)
